# Grasshopper definition Pu.gh (Grasshopper 0.9.76)
# plug-ins: VirtualWindTunnel

panel = Panel("C:\MeshingPaper\Pu\")
number_slider = Slider(1, range=0..1)
toggle = BooleanToggle(True)
wind_dir = ControlKnob(Decimals=0, Limit=True, Maximum=359, Minimum=0, Range=360, Value=0)
geo = Geometry(<brep referenced from the Rhino model>)
xz = XZPlane(Origin=Point(-0.0485980799, -4.042677826, 0))
domaincyl = DomainCyl(
    Geometry=geo,
    Directory="C:\MeshingPaper\Pu\",
    WindDir=wind_dir,
    DivisionsOuterCirc="2",
    DivisionsZ=Slider(10, range=1..100),
    ScaleInnerR=Slider(0.431, range=0..0.8),
    RAM=number_slider,
    CPUs=number_slider,
    Run=toggle)  # -> Out, Domain, Cyl
clean = Clean(Dir="C:\MeshingPaper\Pu\", Run=Button())
c_script = CSharpScript(p=xz)  # -> out, B, A; inputs b: list of Brep, p: Plane
# ---------- c_script: C# ----------
    double pj = 0;
    A = FindFacades(p, b, out pj);
    B = pj;
# ---------- c_script: C# additional code ----------
  static List<Brep> FindFacades(Plane plane, List<Brep> volumes, out double projectedAreaTotal)
  {
    List<Brep> Facades = new List<Brep>();

    List<double> projectedAreas = new List<double>();
    foreach (Brep b in volumes)
    {
      for (int i = 0; i < b.Faces.Count; i++)
      {
        Vector3d vSurf = b.Faces[i].NormalAt(0.5, 0.5);
        double dot = plane.ZAxis * vSurf;
        if (dot < 0.1) continue;


        Brep face = b.Faces[i].DuplicateFace(false);
        //Print(dot + "");
        Facades.Add(face);

        Vector3d cross = Vector3d.CrossProduct(plane.ZAxis, vSurf);
        double norm = cross.Length;
        double angle = Math.Atan2(norm, dot);

        //Print((angle * 180 / Math.PI) + "");

        double projectedArea = face.GetArea() * Math.Cos(angle);

        projectedAreas.Add(projectedArea);
        //Print(projectedArea + "");
      }
    }
    projectedAreaTotal = projectedAreas.Sum(x => x);

    return Facades;
  }
# ---------- end c_script ----------
number_slider_2 = Slider(1, range=0..5)
number_slider_3 = Slider(2, range=0..10)
panel_2 = Panel(c_script.B)
brep = Brep(<brep referenced from the Rhino model>)
cluster = Cluster(B=brep, min_edge=number_slider_2, max_edge=number_slider_2)
mesh = Mesh(
    Domain=domaincyl.Domain,
    AccBuilding=number_slider_3,
    AccFeatures=number_slider_3,
    AccGround=Slider(2, range=0..10),
    Layer=Slider(3, range=0..10),
    Run=toggle)  # -> Out, Domain
number_slider_4 = Slider(1.96, range=0..5)
probes = Probes(Domain=domaincyl.Domain, Points=cluster, PointName=1, Run=Toggle(True))
gradient = Gradient(
    LowerLimit=Slider(0, range=0..10),
    UpperLimit=Slider(15, range=0..25),
    Parameter=probes,
    stops=[0: RGB(234, 38, 0), 0.25: RGB(234, 126, 0), 0.5: RGB(254, 244, 84), 0.75: RGB(173, 203, 249), 1: RGB(75, 107, 169)])
abl = ABL(
    Uref=Slider(12, range=0..100),
    Zref=Slider(12, range=0..100),
    Z0=Slider(12, range=0..100),
    ZGround=Slider(0, range=0..100))
simulation = Simulation(
    Domain=mesh.Domain,
    Iterations=Slider(126, range=0..1000),
    WriteInterval=Slider(8, range=0..100),
    KeepTimeSteps=Slider(4, range=0..10),
    Mode=0,
    Bcond=abl,
    Run=toggle)
vdis = VectorDisplay(Anchor=cluster, Vector=probes)
panel_3 = Panel(probes)
vdisex = VectorDisplayEx(Point=cluster, Vector=probes, Colour=gradient, Width=2)

# ==== cluster Cluster
min_edge = ClusterInput()
max_edge = ClusterInput()
B = ClusterInput()
custom_mesh_settings = SettingsCustom(
    StitchSeams=True,
    SimplePlanes=False,
    Refine=True,
    MinCount=16,
    MaxCount=400,
    AspectRatio=20,
    MaxDistance=0,
    MaxAngle=20,
    MinEdge=min_edge,
    MaxEdge=max_edge)
mesh = MeshBrep(Brep=B, Settings=custom_mesh_settings)
demesh = DeconstructMesh(Mesh=mesh)  # -> Vertices, Faces, Colours, Normals
V = ClusterOutput(demesh.Vertices)
