# Grasshopper definition testFile.gh (Grasshopper 0.9.76)
# plug-ins: VirtualWindTunnel, DIVA Daylight

wind_dir = ControlKnob(Decimals=0, Limit=True, Maximum=359, Minimum=0, Range=360, Value=0)
# 1. this is where you start!
panel = Panel("C:\Users\pkastner\Box Sync\BPACS2018\obstacles\closed\cpPaper4524_0_rhino\")
abl = ABL(
    WDir=wind_dir,
    Uref=Slider(12, range=1..100),
    Zref=Slider(9, range=0..100),
    Z0=Slider(1, range=1..100),
    ZGround=Slider(0, range=0..100))
geo = Geometry(<brep referenced from the Rhino model>)
clean = Clean(Run=Button())
clean_2 = Clean(Dir="C:\MeshingPaper\Niigata_case_ref_app_dimensions_comp\", Run=Button())
domain = Domain(
    Geometry=geo,
    Directory="C:\MeshingPaper\case_ref_app_dimensions_comp\",
    Mode=1,
    BaseMesh=Slider(39, range=0..100),
    RAM=Slider(1, range=0..64000),
    CPUs=Slider(1, range=1..8),
    Run=Toggle(False))  # -> Out, Domain, Cyl, D, E
domaincyl = DomainCyl(
    Geometry=geo,
    Directory=panel,
    BCond=abl,
    DivisionsOuterCirc=Slider(6, range=0..100),
    GradingPerim=Slider(5, range=0..100),
    ScaleInnerR=Slider(29, range=0..100),
    RAM=2000,
    CPUs=1,
    Run=Toggle(True))  # -> Out, Domain, Cyl
panel_2 = Panel(domain.Domain)
number_slider = Slider(2, range=0..10)
number_slider_2 = Slider(1, range=0..10)
cellsize = CellSize(Domain=domain.Domain, Size="20.0", DesiredCellSize="1")
brep = Brep(<brep referenced from the Rhino model>)
mesh = MeshBrep(
    Brep=brep,
    Settings={GridMaxCount=0, GridMinCount=16, JaggedSeams=False, MaxEdgeLength=0, MinEdgeLength=0.0001, MinTolerance=0, Refine=True, RefineAngle=0, RelativeTolerance=0.65, SimplePlanes=True, Tolerance=0})
panel_3 = Panel(cellsize)
mesh_2 = Mesh(
    Domain=domaincyl.Domain,
    AccBuilding=number_slider,
    AccFeatures=number_slider,
    AccRefinement=number_slider,
    AccGround=number_slider_2,
    NLayer=number_slider_2,
    Run=Toggle(True))  # -> Out, Domain
mesh_3 = Mesh(Domain=domain.Domain, Accuracy=panel_3, Run=Toggle(True), Run_2=False)  # -> Out, Domain
mesh_4 = Mesh(mesh)
panel_4 = Panel(mesh_3.Domain)  # disabled
grid = DaylightingGrid(
    Geometry=mesh_4,
    Spacing=0.1,
    BooleanValue_0=False,
    BooleanValue_1=False,
    BooleanValue_10=False,
    BooleanValue_11=False,
    BooleanValue_12=False,
    BooleanValue_13=False,
    BooleanValue_14=False,
    BooleanValue_15=False,
    BooleanValue_16=False,
    BooleanValue_17=False,
    BooleanValue_18=False,
    BooleanValue_19=False,
    BooleanValue_2=False,
    BooleanValue_20=False,
    BooleanValue_21=False,
    BooleanValue_22=False,
    BooleanValue_3=False,
    BooleanValue_4=False,
    BooleanValue_5=False,
    BooleanValue_6=False,
    BooleanValue_7=False,
    BooleanValue_8=False,
    BooleanValue_9=False,
    Color_0=RGBA(0, 0, 0, 0),
    Color_1=RGBA(0, 0, 0, 0),
    Color_10=RGBA(0, 0, 0, 0),
    Color_11=RGBA(0, 0, 0, 0),
    Color_12=RGBA(0, 0, 0, 0),
    Color_13=RGBA(0, 0, 0, 0),
    Color_14=RGBA(0, 0, 0, 0)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)
grid_v = GridViewer(
    Grid=grid,
    active_element_0="Show Grid Faces",
    active_element_1="Show Grid Boundaries",
    active_element_2="Show Grid Wires",
    active_element_3="Show Shades (if active)",
    active_element_4="Show Legend",
    annual_metric=0,
    BooleanValue_0=False,
    BooleanValue_1=False,
    BooleanValue_10=False,
    BooleanValue_11=False,
    BooleanValue_12=False,
    BooleanValue_13=False,
    BooleanValue_14=False,
    BooleanValue_15=False,
    BooleanValue_16=False,
    BooleanValue_17=False,
    BooleanValue_18=False,
    BooleanValue_19=False,
    BooleanValue_2=False,
    BooleanValue_20=False,
    BooleanValue_3=False,
    BooleanValue_4=False,
    BooleanValue_5=False,
    BooleanValue_6=False,
    BooleanValue_7=False,
    BooleanValue_8=False,
    BooleanValue_9=False,
    Color_0=RGBA(0, 0, 0, 0),
    Color_1=RGBA(0, 0, 0, 0),
    Color_10=RGBA(0, 0, 0, 0)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)  # -> SensorPts, SensorData
number_slider_3 = Slider(5, range=0..10)  # disabled
number_slider_4 = Slider(5, range=0..100)  # disabled
number_slider_5 = Slider(10, range=0..1000)  # disabled
toggle = BooleanToggle(False)  # disabled
simulation = Simulation(
    Domain=mesh_2.Domain,
    Iterations=Slider(1000, range=0..1000),
    WriteInterval=Slider(5, range=0..100),
    KeepTimeSteps=Slider(5, range=0..10),
    Mode=0,
    Run=Toggle(True))
patches = Patches(Domain=mesh_2.Domain, Topologies=mesh_4, TopoName="patch", Mode=0)
probes = Probes(Domain=mesh_2.Domain, Points=grid_v.SensorPts, Mode=0, Run=Toggle(True))  # disabled
simulation_2 = Simulation(
    Domain=mesh_3.Domain,
    Iterations=number_slider_5,
    WriteInterval=number_slider_4,
    KeepTimeSteps=number_slider_3,
    Run=toggle,
    Run_2=False)  # disabled
gradient = Gradient(
    LowerLimit=0,
    UpperLimit=1,
    stops=[0: RGB(234, 38, 0), 0.25: RGB(234, 126, 0), 0.463: RGB(254, 244, 84), 0.75: RGB(173, 203, 249), 1: RGB(75, 107, 169)])  # disabled
vdisex = VectorDisplayEx(Colour=gradient, Width=2)  # disabled
